# Grasshopper definition rnd_node - Copy.gh (Grasshopper 1.0.7)

# ---- group: RH_IN:intersect
intersect = BooleanToggle(True)

# ---- group: RH_IN:cells-qty
cell_count = Slider(50, range=10..50)

# ---- group: RH_IN:box-x
box_x = Slider(5, range=5..10)

# ---- group: RH_IN:box-y
box_y = Slider(5, range=5..10)

# ---- group: RH_IN:box-z
box_z = Slider(10, range=5..10)

# ---- group: RH_IN:sphere-radius
sphere_radius = Slider(7, range=2..7)

# ----
center_box = CenterBox(Base=PlaneXY(0, 0, 0), X=box_x, Y=box_y, Z=box_z)
populate_3d = Populate3D(Region=center_box, Count=cell_count, Seed=1)
voronoi_3d = Voronoi3D(Points=populate_3d)  # -> flatten(Cells), Boundary
area = Area(Geometry=voronoi_3d.Cells)  # -> Area, Centroid
sphere = Sphere(Base=PlaneXY(0, 0, 0), Radius=sphere_radius)
point_in_brep = PointInBrep(Brep=sphere, Point=area.Centroid, Strict=True)
cull_pattern = CullPattern(List=voronoi_3d.Cells, CullPattern=invert(point_in_brep))
stream_filter = StreamFilter(Gate=intersect, Stream0=voronoi_3d.Cells, Stream1=cull_pattern)

# ---- group: RH_OUT:mesh
brep = Brep(stream_filter)

# ----
custom_preview = CustomPreview(Geometry=stream_filter, Material=ColourSwatch(SwatchColor=RGB(255, 0, 0)))
